# Grasshopper definition ugh.gh (Grasshopper 0.9.80)

number_slider = Slider(17, range=0..50)
number_slider_2 = Slider(18, range=0..40)
number_slider_3 = Slider(11, range=0..40)
polygon = Polygon(Plane=PlaneXY(0, 0, 0), Radius=Slider(25.4, range=0..550), Segments=Slider(8, range=0..20), FilletRadius=0)  # -> Polygon, Length
multiplication = Multiplication(A=Slider(1.436, range=0..20), B=number_slider_3)
rectangle = Rectangle(Plane=PlaneXY(0, 0, 0), XSize=Slider(3.5, range=0..50), YSize=number_slider_3, Radius=0)  # -> Rectangle, Length
rotate = Rotate(Geometry=polygon.Polygon, Angle=0.3926990817, Plane=PlaneXY(0, 0, 0))  # -> Geometry, Transform
vec = VectorXYZ(XComponent=Slider(-1.526, range=-20..20), YComponent=multiplication, ZComponent=0)  # -> Vector, Length
move = Move(Geometry=rectangle.Rectangle, Motion=vec.Vector)  # -> Geometry, Transform
rad = Radians(Degrees=Slider(360, range=0..360))
arrpolar = PolarArray(Geometry=move.Geometry, Plane=PlaneXY(0, 0, 0), Count=Slider(4, range=0..20), Angle=rad)  # -> Geometry, Transform
